# Grasshopper definition ht.gh (Grasshopper 0.9.72)

pt = ConstructPoint(XCoordinate=0, YCoordinate=0, ZCoordinate=0)
crv = Curve([<curve referenced from the Rhino model> x9])
end = EndPoints(Curve=crv)  # -> Start, End
end_2 = EndPoints(Curve=crv)  # -> Start, End
flip = FlipCurve(Curve=crv)  # -> Curve, Flag
points = PointList(Points=end.End, Tags=True, Lines=True, Size=3)
panel = Panel("""4.7
9.5
14.3""")
pdecon = Deconstruct(Point=end_2.Start)  # -> XComponent, YComponent, ZComponent
pdecon_2 = Deconstruct(Point=end_2.End)  # -> XComponent, YComponent, ZComponent
vb = VBScript(x=pdecon.ZComponent, y=pdecon_2.ZComponent, z=crv, u=flip.Curve)  # -> out, A
# ---------- vb: C# ----------
    A = z
    if y < x then A = u
# ---------- end vb ----------
Z = UnitZ(Factor=panel)
pt_2 = Point([Point(141.7636094, 310.67125, 1.064993253e-06), Point(141.7636094, 322.3274288, 1.064993253e-06), Point(126.8786637, 330.92125, 1.064993253e-06), Point(113.0136172, 330.92125, 1.064993253e-06), Point(113.0136172, 310.67125, 1.064993253e-06)])
crv_2 = Curve(<curve referenced from the Rhino model>)
Z_2 = UnitZ(Factor=15)
move = Move(Geometry=crv_2, Motion=Z)  # -> Geometry, Transform
series = Series(Start=0, Step="0.2", Count="84")
offset = Offset(Curve=crv_2, Distance=-0.5, Plane=PlaneXY(0, 0, 0), Corners=1)
crv_3 = Curve(vb.A)
xy = XYPlane(Origin=Point(0, 0, 0))
pline = PolyLine(Vertices=pt_2, Closed=True)
y_scalelist = Y_scaleList(listIn=series, maxExp=1)  # -> out, listOut; inputs listIn: list of Double, minExp: Double, maxExp: Double
# ---------- y_scalelist: C# ----------
    if(listIn.Count != 0)
    {
      List < double > listZhuan = new List < double >();
      for(int i = 0;i < listIn.Count;i++)
      {
        listZhuan.Add(listIn[i]);
      }
      int sign;

      do
      {sign = 0;
        for(int i = 0;i < listIn.Count - 1;i++)
        {
          if(listIn[i] > listIn[i + 1])
          {
            double zhuan = listIn[i];
            listIn[i] = listIn[i + 1];
            listIn[i + 1] = zhuan;
            sign = 1;
          }
        }
      }
      while(sign == 1);

      if (maxExp > minExp)
      {
        double length = listIn[listIn.Count - 1] - listIn[0];
        double length2 = maxExp - minExp;
        List < double > position = new List <double>();
        List < double > listScale = new List <double>();

        for(int j = 0;j < listIn.Count;j++)
        {
          double p = (listZhuan[j] - listIn[0]) / length;
          position.Add(p);
          double s = length2 * position[j] + minExp;
          listScale.Add(s);
        }
        listOut = listScale;
      }
      if (maxExp == minExp)
      {
        string warning1 = "maxExp的值不能与minExp的值相等！";
        listOut = warning1;
      }
      if (minExp > maxExp)
      {
        string warning2 = "minExp的值不能大于maxExp的值！";
        listOut = warning2;
      }
    }
# ---------- end y_scalelist ----------
srf = Surface(<surface referenced from the Rhino model>)
end_3 = EndPoints(Curve=move.Geometry)  # -> Start, End
Z_3 = UnitZ(Factor=series)
end_4 = EndPoints(Curve=crv_3)  # -> Start, End
explode = Explode(Curve=pline, Recursive=True)  # -> graft(Segments), Vertices
extr = Extrude(Base=offset, Direction=Z_2)
xy_2 = XYPlane(Origin=end_3.Start)
lng = ListLength(List=end_4.Start)
move_2 = Move(Geometry=xy, Motion=Z_3)  # -> Geometry, Transform
len = Length(Curve=explode.Segments)
pcx = CurvePlane(Curve=crv_3, Plane=graft(move_2.Geometry))  # -> simplify(Points), ParamsC, ParamsP
series_2 = Series(Start=0, Step=1, Count=lng)
graph = GraphMapper(
    y_scalelist.listOut,
    x0=0,
    x1=1,
    y0=0,
    y1=1,
    container_name="Bezier",
    cpx=[0, 0.6818141937, 0.6637679338, 1],
    cpy=[0.6878964901, 0.7885751128, 0, 0.353448838])
graph_2 = GraphMapper(
    y_scalelist.listOut,
    x0=0,
    x1=1,
    y0=0,
    y1=1,
    container_name="Bezier",
    cpx=[0, 0.4077241123, 0.5787587166, 1],
    cpy=[0.8851555586, 0.4442672729, 0.2876663208, 0.4938884377])
graph_3 = GraphMapper(
    y_scalelist.listOut,
    x0=0,
    x1=1,
    y0=0,
    y1=1,
    container_name="Bezier",
    cpx=[0, 0.7591778636, 0.0005523251602, 1],
    cpy=[1, 1, 0, 0.5390222073])
graph_4 = GraphMapper(
    y_scalelist.listOut,
    x0=0,
    x1=1,
    y0=0,
    y1=1,
    container_name="Bezier",
    cpx=[0, 0.7386664748, 0.8150659204, 1],
    cpy=[0.07971012592, 0.03834199905, 0.5295648575, 1])
graph_5 = GraphMapper(
    y_scalelist.listOut,
    x0=0,
    x1=1,
    y0=0,
    y1=1,
    container_name="Bezier",
    cpx=[0, 0.5838986039, 0.8031210303, 1],
    cpy=[0.7004386187, 0.6950001121, 0.8144667149, 0.9538447261])
graph_6 = GraphMapper(
    y_scalelist.listOut,
    x0=0,
    x1=1,
    y0=0,
    y1=1,
    container_name="Bezier",
    cpx=[0, 0.542318821, 0.07855069637, 1],
    cpy=[0.03038311005, 0.07014530897, 0.9049275517, 1])
graph_7 = GraphMapper(
    y_scalelist.listOut,
    x0=0,
    x1=1,
    y0=0,
    y1=1,
    container_name="Bezier",
    cpx=[0, 0.5950363874, 0, 1],
    cpy=[1, 0.8813892007, 0, 0.005995035172])
graph_8 = GraphMapper(
    y_scalelist.listOut,
    x0=0,
    x1=1,
    y0=0,
    y1=1,
    container_name="Bezier",
    cpx=[0, 0.393600136, 0.6902070045, 1],
    cpy=[0.1133321151, 0.6768883467, 0.7622214556, 0.8599989414])
graph_9 = GraphMapper(
    y_scalelist.listOut,
    x0=0,
    x1=1,
    y0=0,
    y1=1,
    container_name="Bezier",
    cpx=[0, 0.7132394314, 0.6321125031, 1],
    cpy=[0.5455551147, 0.08777785301, 0.5055558681, 0.6415549517])
integer_division = IntegerDivision(A=len, B="2")
tag = TextTag3D(Location=end_4.Start, Text=series_2, Size=1, Justification=7)
path_mapper = PathMapper(pcx.Points, source="{A;B}", target="{A}")
offset_2 = Offset(Curve=pline, Distance=1, Plane=PlaneXY(0, 0, 0), Corners=1)
graft = GraftTree(Tree=graph_2, IncludeEmptyLists=True, IncludeNullItems=True)  # -> simplify(Tree)
graft_2 = GraftTree(Tree=graph, IncludeEmptyLists=True, IncludeNullItems=True)  # -> simplify(Tree)
graft_3 = GraftTree(Tree=graph_3, IncludeEmptyLists=True, IncludeNullItems=True)  # -> simplify(Tree)
graft_4 = GraftTree(Tree=graph_4, IncludeEmptyLists=True, IncludeNullItems=True)  # -> simplify(Tree)
graft_5 = GraftTree(Tree=graph_5, IncludeEmptyLists=True, IncludeNullItems=True)  # -> simplify(Tree)
graft_6 = GraftTree(Tree=graph_6, IncludeEmptyLists=True, IncludeNullItems=True)  # -> simplify(Tree)
graft_7 = GraftTree(Tree=graph_7, IncludeEmptyLists=True, IncludeNullItems=True)  # -> simplify(Tree)
graft_8 = GraftTree(Tree=graph_8, IncludeEmptyLists=True, IncludeNullItems=True)  # -> simplify(Tree)
graft_9 = GraftTree(Tree=graph_9, IncludeEmptyLists=True, IncludeNullItems=True)  # -> simplify(Tree)
explode_2 = Explode(Curve=offset_2, Recursive=True)  # -> Segments, Vertices
pline_2 = PolyLine(Vertices=path_mapper, Closed=True)
item = ListItem(List=reverse(explode_2.Vertices), Index=1, Wrap=True)
crv_cp = CurveClosestPoint(Point=item, Curve=offset_2)  # -> Point, Parameter, Distance
multiplication = Multiplication(A=graft, B=Slider(7.836, range=0..10))
multiplication_2 = Multiplication(A=graft_4, B=Slider(30, range=0..30))
multiplication_3 = Multiplication(A=graft_2, B=Slider(15.657, range=0..30))
multiplication_4 = Multiplication(A=graft_3, B=Slider(30, range=0..30))
multiplication_5 = Multiplication(A=graft_5, B=Slider(6.584, range=0..10))
multiplication_6 = Multiplication(A=graft_7, B=Slider(4.505, range=0..10))
multiplication_7 = Multiplication(A=graft_6, B=Slider(9.167, range=0..10))
multiplication_8 = Multiplication(A=graft_8, B=Slider(10, range=0..30))
multiplication_9 = Multiplication(A=graft_9, B=Slider(8.361, range=0..10))
len_2 = Length(Curve=crv_2)
c_script = CSharpScript(x=crv_cp.Parameter, y=offset_2)  # -> out, A; inputs x: Double, y: Curve
# ---------- c_script: C# ----------
    y.ChangeClosedCurveSeam(x);
    A = y;
# ---------- end c_script ----------
division = Division(A=len_2, B="1.8")
simplify = SimplifyCurve(Curve=c_script.A)  # -> Curve, Simplified
crv_4 = Curve(simplify(graft(pline_2)))
divide = DivideCurve(Curve=crv_2, Count=division, Kinks=False)  # -> Points, Tangents, Parameters
Z_4 = UnitZ(Factor=1)
explode_3 = Explode(Curve=simplify.Curve, Recursive=True)  # -> graft(Segments), Vertices

divide_2 = DivideCurve(Curve=explode.Segments, Count=integer_division, Kinks=False)  # -> Points, Tangents, Parameters; disabled
cull_i = CullIndex(List=divide_2.Points, Indices=0, Wrap=True)  # disabled
ln = Line(StartPoint=explode.Vertices, EndPoint=explode_3.Vertices)  # disabled
cull_i_2 = CullIndex(List=reverse(cull_i), Indices=0, Wrap=True)  # -> reverse(List); disabled
end_5 = EndPoints(Curve=ln)  # -> Start, End; disabled
crv_cp_2 = CurveClosestPoint(Point=cull_i_2, Curve=pline)  # -> Point, Parameter, Distance; disabled
eval = EvaluateCurve(Curve=pline, Parameter=crv_cp_2.Parameter)  # -> Point, Tangent, Angle; disabled
Z_5 = UnitZ(Factor=1)  # disabled
panel_2 = Panel("-90")  # disabled
vrot = Rotate(Vector=eval.Tangent, Axis=Z_5, Angle=degrees(panel_2))  # disabled
panel_3 = Panel("8")  # disabled
line = LineSDL(Start=end_5.Start, Direction=ln, Length=panel_3)  # disabled
line_2 = LineSDL(Start=eval.Point, Direction=vrot, Length=panel_3)  # disabled
panel_4 = Panel("20")  # disabled
crv_5 = Curve(flatten([line_2, line]))  # disabled
Z_6 = UnitZ(Factor=panel_4)  # disabled
extr_2 = Extrude(Base=crv_5, Direction=Z_6)  # disabled

vrot_2 = Rotate(Vector=divide.Tangents, Axis=Z_4, Angle=degrees("-90"))
Z_7 = UnitZ(Factor=20)
num = Number([multiplication_3, multiplication_4, multiplication_2, multiplication, multiplication_5, multiplication_7, multiplication_6, multiplication_9, multiplication_8])
move_3 = Move(Geometry=divide.Points, Motion=expr("-x", vrot_2))  # -> Geometry, Transform
panel_5 = Panel(num)
move_4 = Move(Geometry=divide.Points, Motion=expr("-x/2", vrot_2))  # -> Geometry, Transform
c_script_2 = CSharpScript(pl=crv_4, r=num)  # -> out, simplify(A); inputs pl: Polyline, r: list of Double
# ---------- c_script_2: C# ----------
    List<Curve> cc = new List<Curve>();
    for(int i = 0;i < pl.SegmentCount;i++){
      Curve c1 = pl.SegmentAt(i).ToNurbsCurve();
      Curve c2 = pl.SegmentAt(i).ToNurbsCurve();
      if(i < pl.SegmentCount - 1){
        c2 = pl.SegmentAt(i + 1).ToNurbsCurve();
      }else{
      c2=pl.SegmentAt(0).ToNurbsCurve();
      }
      c2.Reverse();
      c1.Domain = new Interval(0, 1);
      c2.Domain = new Interval(0, 1);
      cc.Add(Curve.CreateFillet(c1, c2, r[i], 0, 0).ToNurbsCurve());
    }
    A = cc;
# ---------- end c_script_2 ----------
line_3 = LineSDL(Start=move_3.Geometry, Direction=vrot_2, Length="8")  # -> simplify(graft(Line))
end_6 = EndPoints(Curve=c_script_2.A)  # -> Start, End
line_4 = LineSDL(Start=move_4.Geometry, Direction=vrot_2, Length="8")  # -> simplify(graft(Line))
shift = ShiftList(List=end_6.Start, Shift=1, Wrap=True)
ln_2 = Line(StartPoint=shift, EndPoint=end_6.End)  # -> simplify(Line)
Z_8 = UnitZ(Factor="15")
pt_3 = Point(move_4.Geometry)
crv_6 = Curve([c_script_2.A, ln_2])
join = JoinCurves(Curves=crv_6, Preserve=False)
move_5 = Move(Geometry=line_4, Motion=Z_8)  # -> simplify(Geometry), Transform
reb = RebuildCurve(Curve=join, Degree=3, Count="100", Tangents=False)

crv_7 = Curve(flatten(reb))
item_2 = ListItem(List=reverse(flatten(crv_7)), Index=0, Wrap=True)
len_3 = Length(Curve=item_2)
division_2 = Division(A=len_3, B="2")
divide_3 = DivideCurve(Curve=item_2, Count=division_2, Kinks=False)  # -> Points, Tangents, Parameters
project = Project(Geometry=divide_3.Points, Plane=PlaneXY(0, 0, 0))  # -> Geometry, Transform
crv_cp_3 = CurveClosestPoint(Point=project.Geometry, Curve=crv_2)  # -> Point, Parameter, Distance
vec2pt = Vector2Pt(PointA=crv_cp_3.Point, PointB=project.Geometry, Unitize=False)  # -> Vector, Length
line_5 = LineSDL(Start=crv_cp_3.Point, Direction=vec2pt.Vector, Length=10)  # -> simplify(Line)

crv_8 = Curve(reb)
loft = Loft(Curves=flatten(crv_8), Options={Adjust=False, Closed=False, LoftEnds=0, LoftSimp=0, LoftType=0, Rebuild=10, Refit=0.01})
panel_7 = Panel("""0
4.8
9.6""")
addition = Addition(A=panel_7, B="4.8")
Z_9 = UnitZ(Factor=panel_7)
Z_10 = UnitZ(Factor=addition)
Z_11 = UnitZ(Factor="20")
extr_3 = Extrude(Base=line_3, Direction=Z_7)  # -> flatten(Extrusion)
line_6 = Line(Line((145.6143493, 296.1928039, 0), (131.0885967, 310.6960315, 0)))
crv_9 = Curve(simplify(reb))
move_6 = Move(Geometry=line_4, Motion=Z_9)  # -> simplify(Geometry), Transform
move_7 = Move(Geometry=line_4, Motion=Z_10)  # -> simplify(Geometry), Transform
extr_4 = Extrude(Base=line_6, Direction=Z_11)
Z_12 = UnitZ(Factor=20)
line_7 = Line(move_7.Geometry)
line_8 = Line(move_6.Geometry)
scx = SurfaceCurve(Surface=extr_4, Curve=crv_9)  # -> Curves, Points, UVPoints, Normals, Parameters, Tangents
end_7 = EndPoints(Curve=line_7)  # -> Start, End
end_8 = EndPoints(Curve=line_8)  # -> Start, End
extr_5 = Extrude(Base=line_5, Direction=Z_12)  # -> flatten(Extrusion)
c_script_3 = CSharpScript(x=crv_9, y=scx.Parameters)  # -> out, A; inputs x: Curve, y: Double
# ---------- c_script_3: C# ----------
    x.ChangeClosedCurveSeam(y);
    A = x;
# ---------- end c_script_3 ----------
panel_8 = Panel("""0
3.6
4.8
8.4
9.6
13.2
14.4
15""")
srf_2 = Surface(extr_5)
panel_9 = Panel("""0
4.8
9.6
14.4""")
line_9 = LineSDL(Start=end_8.Start, Direction=line_8, Length="0.05")  # -> simplify(graft(Line))
line_10 = LineSDL(Start=end_7.Start, Direction=line_7, Length="0.05")  # -> simplify(graft(Line))
genes = GenePool(Decimals=2, Maximum=1, Minimum=0, Value=[0.73, 0.42, 0.26, 0.72, 0.53, 0.89, 0.5, 0.7, 1])
offset_3 = Offset(Curve=crv_2, Distance=expr("-x", "0.5"), Plane=PlaneXY(0, 0, 0), Corners=1)
reb_2 = RebuildCurve(Curve=c_script_3.A, Degree=3, Count="100", Tangents=False)
Z_13 = UnitZ(Factor=panel_8)
offset_4 = Offset(Curve=crv_2, Distance=expr("-x", "0.55"), Plane=PlaneXY(0, 0, 0), Corners=1)
Z_14 = UnitZ(Factor=panel_9)
crv_10 = Curve(simplify(reb_2))
loft_2 = Loft(
    Curves=[line_9, line_10],
    Options={Adjust=False, Closed=False, LoftEnds=0, LoftSimp=0, LoftType=0, Rebuild=10, Refit=0.01})
move_8 = Move(Geometry=offset_3, Motion=Z_13)  # -> Geometry, Transform
move_9 = Move(Geometry=offset_4, Motion=Z_14)  # -> Geometry, Transform
crv_11 = Curve(reparameterize([<curve referenced from the Rhino model> x9]))
boundary = BoundarySurfaces(Edges=move_9.Geometry)
cull_i_3 = CullIndex(List=reverse(move_8.Geometry), Indices=0, Wrap=True)  # -> reverse(simplify(graft(List)))
cull_i_4 = CullIndex(List=move_8.Geometry, Indices=0, Wrap=True)  # -> simplify(graft(List))
eval_2 = EvaluateCurve(Curve=crv_11, Parameter=genes)  # -> Point, Tangent, Angle
offset_5 = Offset(Curve=cull_i_4, Distance="0.1", Plane=PlaneXY(0, 0, 0), Corners=1)  # -> simplify(Curve)
loft_3 = Loft(
    Curves=[cull_i_4, cull_i_3],
    Options={Adjust=False, Closed=False, LoftEnds=0, LoftSimp=0, LoftType=0, Rebuild=10, Refit=0.01})
boundary_2 = BoundarySurfaces(Edges=[offset_5, cull_i_4])
crv_12 = Curve(graft([<curve referenced from the Rhino model> x4]))

# ---- group: 门
crv_13 = Curve(graft([<curve referenced from the Rhino model> x4]))

# ----
crv_14 = Curve(graft(crv_13))
crv_15 = Curve(graft(crv_12))
boundary_3 = BoundarySurfaces(Edges=crv_14)
boundary_4 = BoundarySurfaces(Edges=crv_15)
area = Area(Geometry=boundary_3)  # -> Area, Centroid
area_2 = Area(Geometry=boundary_4)  # -> Area, Centroid
srf_cp = SurfaceClosestPoint(Point=area.Centroid, Surface=boundary_3)  # -> Point, UVPoint, Distance
srf_cp_2 = SurfaceClosestPoint(Point=area_2.Centroid, Surface=boundary_4)  # -> Point, UVPoint, Distance
scale = Scale(Geometry=crv_14, Center=area.Centroid, Factor="0.8")  # -> Geometry, Transform
scale_2 = Scale(Geometry=crv_15, Center=area_2.Centroid, Factor="0.8")  # -> Geometry, Transform
evalsrf = EvaluateSurface(Surface=boundary_3, Point=srf_cp.UVPoint)  # -> Point, Normal, Frame
evalsrf_2 = EvaluateSurface(Surface=boundary_4, Point=srf_cp_2.UVPoint)  # -> Point, Normal, Frame
loft_4 = Loft(Curves=flatten(crv_10), Options={Adjust=False, Closed=False, LoftEnds=0, LoftSimp=0, LoftType=0, Rebuild=10, Refit=0.01})
srf_3 = Surface(reparameterize(loft_4))
srf_cp_3 = SurfaceClosestPoint(Point=eval_2.Point, Surface=srf_3)  # -> Point, UVPoint, Distance
crvsrf = CurveOnSurface(Surface=srf_3, UVCoordinates=srf_cp_3.UVPoint, Closed=False)  # -> Curve, Length, Domain
offset_6 = Offset(Curve=crvsrf.Curve, Distance=expr("-x", "5"), Plane=PlaneXY(0, 0, 0), Corners=1)
multiplication_10 = Multiplication(A=evalsrf.Normal, B=Slider(-20, range=-20..20))
multiplication_11 = Multiplication(A=evalsrf_2.Normal, B=Slider(-14.787, range=-20..20))
scx_2 = SurfaceCurve(Surface=srf_2, Curve=crv_10)  # -> Curves, simplify(Points), UVPoints, Normals, simplify(Parameters), Tangents
extr_6 = Extrude(Base=scale_2.Geometry, Direction=multiplication_11)  # -> flatten(Extrusion)
extr_7 = Extrude(Base=crv_14, Direction=multiplication_10)  # -> flatten(Extrusion)
extr_8 = Extrude(Base=crv_15, Direction=multiplication_11)  # -> flatten(Extrusion)
extr_9 = Extrude(Base=scale.Geometry, Direction=multiplication_10)  # -> flatten(Extrusion)
offset_7 = Offset(Surface=loft_4, Distance=expr("-x", "-0.5"), Retrim=True)
offset_8 = Offset(Surface=loft_4, Distance="-0.25", Retrim=True)
srf_4 = Surface(extr_6)
srf_5 = Surface(extr_8)
srf_6 = Surface(extr_9)
srf_7 = Surface(extr_7)
path_mapper_2 = PathMapper(scx_2.Points, source="{A;B}", target="{B}")
crv_16 = Curve(move_5.Geometry)
path_mapper_3 = PathMapper(scx_2.Parameters, source="{A;B}", target="{A}")
Z_15 = UnitZ(Factor="9.6")
move_10 = Move(Geometry=line_5, Motion=Z_15)  # -> simplify(graft(Geometry)), Transform
end_9 = EndPoints(Curve=move_10.Geometry)  # -> graft(Start), End
pline_3 = PolyLine(Vertices=path_mapper_2, Closed=False)
crv_17 = Curve(simplify(pline_3))
ccx = CurveCurve(CurveA=move_10.Geometry, CurveB=crv_17)  # -> Points, ParamsA, ParamsB
shatter = Shatter(Curve=crv_10, Parameters=path_mapper_3)  # -> graft(Segments)
bbx = BrepBrep(BrepA=offset_7, BrepB=srf_6)  # -> flatten(Curves), Points
bbx_2 = BrepBrep(BrepA=offset_8, BrepB=srf_7)  # -> flatten(Curves), Points
bbx_3 = BrepBrep(BrepA=offset_7, BrepB=srf_4)  # -> flatten(Curves), Points
bbx_4 = BrepBrep(BrepA=offset_8, BrepB=srf_5)  # -> flatten(Curves), Points
explode_4 = Explode(Curve=pline_3, Recursive=True)  # -> Segments, Vertices
crv_18 = Curve(flatten(offset_6))
ln_3 = Line(StartPoint=end_9.Start, EndPoint=ccx.Points)
curvepoint = PointOnCurve(shatter, parameter=0.5)
graft_10 = GraftTree(Tree=bbx.Curves, IncludeEmptyLists=True, IncludeNullItems=True)
polygon = Polygon(Plane=explode_4.Vertices, Radius=0.05, Segments=6, FilletRadius=0)  # -> simplify(Polygon), Length
graft_11 = GraftTree(Tree=bbx_2.Curves, IncludeEmptyLists=True, IncludeNullItems=True)
graft_12 = GraftTree(Tree=bbx_3.Curves, IncludeEmptyLists=True, IncludeNullItems=True)
graft_13 = GraftTree(Tree=bbx_4.Curves, IncludeEmptyLists=True, IncludeNullItems=True)
toggle = BooleanToggle(True)
toggle_2 = BooleanToggle(False)
divide_4 = DivideCurve(Curve=graft_11, Count="100", Kinks=False)  # -> Points, Tangents, Parameters
divide_5 = DivideCurve(Curve=graft_10, Count="100", Kinks=False)  # -> Points, Tangents, Parameters
divide_6 = DivideCurve(Curve=graft_13, Count="100", Kinks=False)  # -> Points, Tangents, Parameters
divide_7 = DivideCurve(Curve=graft_12, Count="100", Kinks=False)  # -> Points, Tangents, Parameters
Z_16 = UnitZ(Factor="-0.2")
Z_17 = UnitZ(Factor="-0.1")
nurbs = NurbsCurve(Vertices=divide_4.Points, Degree=3, Periodic=toggle_2)  # -> Curve, Length, Domain
nurbs_2 = NurbsCurve(Vertices=divide_5.Points, Degree=3, Periodic=toggle_2)  # -> Curve, Length, Domain
nurbs_3 = NurbsCurve(Vertices=divide_6.Points, Degree=3, Periodic=toggle)  # -> Curve, Length, Domain
nurbs_4 = NurbsCurve(Vertices=divide_7.Points, Degree=3, Periodic=toggle)  # -> Curve, Length, Domain
move_11 = Move(Geometry=end_9.Start, Motion=Z_16)  # -> Geometry, Transform
move_12 = Move(Geometry=ccx.Points, Motion=Z_17)  # -> Geometry, Transform
ext = ExtendCurve(Curve=ln_3, Type=0, Start=0, End="-0.2")
loft_5 = Loft(
    Curves=[nurbs_4.Curve, nurbs_3.Curve],
    Options={Adjust=False, Closed=False, LoftEnds=0, LoftSimp=0, LoftType=0, Rebuild=10, Refit=0.01})
srf_8 = Surface(simplify(graft(loft_5)))  # disabled
sec = BrepPlane(Brep=srf_8, Plane=xy_2)  # -> Curves, Points
curvepoint_2 = PointOnCurve(sec.Curves, parameter=0.5)
srf_cp_4 = SurfaceClosestPoint(Point=curvepoint_2, Surface=extr)  # -> Point, UVPoint, Distance
ln_4 = Line(StartPoint=curvepoint_2, EndPoint=srf_cp_4.Point)
pipe = Pipe(Curve=ln_4, Radius=0.1, Caps=0)
loft_6 = Loft(
    Curves=[nurbs_2.Curve, nurbs.Curve],
    Options={Adjust=False, Closed=False, LoftEnds=0, LoftSimp=0, LoftType=0, Rebuild=10, Refit=0.01})
ln_5 = Line(StartPoint=move_11.Geometry, EndPoint=move_12.Geometry)
bbx_5 = BrepBrep(BrepA=loft_4, BrepB=flatten([loft_5, loft_6]))  # -> flatten(Curves), Points
crv_19 = Curve(flatten([bbx_5.Curves, crv_18]))
crv_cp_4 = CurveClosestPoint(Point=curvepoint, Curve=crv_19)  # -> Point, Parameter, Distance
sort = SortList(Keys=crv_cp_4.Distance)  # -> Keys, ValuesA
item_3 = ListItem(List=sort.Keys, Index=0, Wrap=True)  # -> simplify(Item)
multiplication_12 = Multiplication(A=item_3, B="0.03")
vb_2 = VBScript(x=multiplication_12)  # -> out, A
# ---------- vb_2: C# ----------
    A = x
    A = Convert.ToInt32(A * 20) / 20.0
    randomize
    A = A + (rnd - 0.5) * 2 * 0.1
    If A < 0.05 Then A = 0.05
    If A > 0.15 Then A = 0.15
    A = 0.2 - A
# ---------- end vb_2 ----------
graph_10 = GraphMapper(vb_2.A, x0=0.05, x1=0.15, y0=1, y1=4, container_name="Bezier", cpx=[0, 0.25, 0.75, 1], cpy=[0, 0.25, 0.75, 1])
srf_9 = Surface(reparameterize([loft_5, loft_6]))
loft_7 = Loft(Curves=flatten(ext), Options={Adjust=False, Closed=True, LoftEnds=0, LoftSimp=0, LoftType=3, Rebuild=10, Refit=0.01})
loft_8 = Loft(Curves=[ln_5, ln_3], Options={Adjust=False, Closed=False, LoftEnds=0, LoftSimp=0, LoftType=0, Rebuild=10, Refit=0.01})  # -> simplify(Loft)
int = Integer(graph_10)
division_3 = Division(A=int, B="40")
Z_18 = UnitZ(Factor=division_3)
extr_10 = Extrude(Base=shatter, Direction=Z_18)  # -> simplify(Extrusion)

area_3 = Area(Geometry=loft_8)  # -> Area, Centroid
offset_9 = Offset(Surface=loft_8, Distance="0.015", Retrim=True)
area_4 = Area(Geometry=offset_9)  # -> Area, Centroid
vec2pt_2 = Vector2Pt(PointA=area_4.Centroid, PointB=area_3.Centroid, Unitize=False)  # -> Vector, Length
multiplication_13 = Multiplication(A=vec2pt_2.Vector, B=2)
extr_11 = Extrude(Base=offset_9, Direction=multiplication_13)

loft_9 = Loft(Curves=polygon.Polygon, Options={Adjust=False, Closed=False, LoftEnds=0, LoftSimp=0, LoftType=3, Rebuild=10, Refit=0.01})
path_mapper_4 = PathMapper(extr_10, source="{A;B}", target="{A}")
join_2 = BrepJoin(Breps=path_mapper_4)  # -> Breps, Closed
